# Grasshopper definition honeybee-ifc.gh (Grasshopper 1.0.7)
# plug-ins: Human

panel = Panel("C:\Users\devan\simulation\BEM_Example_ArchiCAD.hbjson")
panel_2 = Panel("C:\Users\devan\simulation\FamilyHouse_AC13.hbjson")
loadobjects = HBLoadObjects(hb_file="C:\Users\devan\simulation\SmallOffice_d_IFC2x3.hbjson", load=Toggle(True))  # -> report, hb_objs; plug-in component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
deconstructmodel = HBDeconstructModel(model=loadobjects.hb_objs)  # -> rooms, faces, apertures, doors, shades; plug-in component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
vizquick = HBVizualizeQuick(hb_objs=flatten(deconstructmodel.rooms))  # -> geo; plug-in component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
vizquick_2 = HBVizualizeQuick(hb_objs=flatten(deconstructmodel.apertures))  # -> geo; plug-in component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
vizquick_3 = HBVizualizeQuick(hb_objs=flatten(deconstructmodel.doors))  # -> geo; plug-in component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
vizquick_4 = HBVizualizeQuick(hb_objs=flatten(deconstructmodel.shades))  # -> geo; plug-in component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
wires = BrepWireframe(Brep=[vizquick, vizquick_4], Density=-1)
preview = CustomPreview(Geometry=vizquick_2, Material=ColourSwatch(SwatchColor=RGB(0, 210, 255)))
preview_2 = CustomPreview(Geometry=vizquick_3, Material=ColourSwatch(SwatchColor=RGB(58, 0, 0)))
facen = FaceNormals(Mesh=vizquick_2)  # -> Centers, Normals
facen_2 = FaceNormals(Mesh=vizquick_3)  # -> Centers, Normals
vdis = VectorDisplay(Anchor=facen.Centers, Vector=facen.Normals)
vdis_2 = VectorDisplay(Anchor=facen_2.Centers, Vector=facen_2.Normals)
file = ReadFile(File="D:\Github\honeybee-ifc\honeybee_ifc\zone_storeys.py", PerLineParse=False)
roomattr = HBRoomAttributes({"Display Name": "display_name", "Simulation Name (Identifier)": "identifier", "Multiplier": "multiplier", "Story": "story", "Volume": "volume", "Gross Floor Area": "floor_area", "Exposed Area": "exposed_area", "Exterior Wall Area": "exterior_wall_area", "Exterior Aperture Area": "exterior_aperture_area", "Average Floor Elevation": "average_floor_height"}, selected="Display Name")
python = GhPythonScript(Code=file, Zones=deconstructmodel.rooms, Floor="00")  # -> Out, Floors, Rooms
vizquick_5 = HBVizualizeQuick(hb_objs=flatten(python.Rooms))  # -> geo; plug-in component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
labelrooms = HBLabelRooms(rooms_model=flatten(python.Rooms), attribute=roomattr)  # -> label_text, base_pts, labels, wire_frame; plug-in component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
panel_3 = Panel("""Room_ad995829
Room_6a157448""")
panel_4 = Panel("""Room_18cec72b
Room_ad995829
Room_6a157448""")
python_2 = GhPythonScript(room_names=labelrooms.label_text, selected_names=panel_3)  # -> out, a; inputs room_names: list, selected_names: list
# ---------- python_2: Python ----------
__author__ = "devan"
__version__ = "2021.10.05"

import rhinoscriptsyntax as rs

a = [item in selected_names for item in room_names]
# ---------- end python_2 ----------
dispatch = Dispatch(List=python.Rooms, DispatchPattern=python_2.a)  # -> ListA, ListB
vizquick_6 = HBVizualizeQuick(hb_objs=flatten(dispatch.ListA))  # -> geo; plug-in component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
wires_2 = BrepWireframe(Brep=vizquick_6, Density=-1)
preview_3 = CustomPreview(
    Geometry=wires_2,
    Material={diffuse=RGB(221, 160, 221), emission=RGB(66, 48, 66), shine=0.5, specular=RGB(255, 255, 255), transparency=0})
zones = Data(dispatch.ListA)
file_2 = ReadFile(File="D:\Github\honeybee-ifc\honeybee_ifc\close_gap.py", PerLineParse=False)
roomattr_2 = HBRoomAttributes({"Display Name": "display_name", "Simulation Name (Identifier)": "identifier", "Multiplier": "multiplier", "Story": "story", "Volume": "volume", "Gross Floor Area": "floor_area", "Exposed Area": "exposed_area", "Exterior Wall Area": "exterior_wall_area", "Exterior Aperture Area": "exterior_aperture_area", "Average Floor Elevation": "average_floor_height"}, selected="Display Name")
python_3 = GhPythonScript(Code=file_2, Rooms=python.Rooms)  # -> Out, A, Moved_rooms
panel_5 = Panel("""10.70,8.20,2.05
9.31,8.20,2.05""")
labelrooms_2 = HBLabelRooms(rooms_model=flatten(zones), attribute=roomattr_2)  # -> label_text, base_pts, labels, wire_frame; plug-in component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
pt = Point(panel_5)
vizquick_7 = HBVizualizeQuick(hb_objs=flatten(python_3.Moved_rooms))  # -> geo; plug-in component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
bake = BakeGeometry(Bake=Button(), Geometry=vizquick_5, DeleteOldBakes=False, PreserveTrees=False)
wires_3 = BrepWireframe(Brep=vizquick_7, Density=-1)
preview_4 = CustomPreview(
    Geometry=vizquick_7,
    Material={diffuse=RGB(221, 160, 221), emission=RGB(66, 48, 66), shine=0.5, specular=RGB(255, 255, 255), transparency=0})
screentext = ScreenOrientedText(Text=labelrooms_2.label_text, Justification=7, Location=labelrooms_2.base_pts, SizeFactor="15", Depth=0, Absolute=False)
panel_6 = Panel(python_3.Out)
